# Grasshopper definition 1.2CircleCNR.gh (Grasshopper 0.9.80)
# plug-ins: Bifocals

# Set point param to 0,0,0
# PLAY with Sliders
number_slider = Slider(20, range=0..20)
point = Point(Point(0, 0, 0))
unit_z = UnitZ(Factor=number_slider)
circle_cnr = CircleCNR(Center=point, Normal=Vector(0, 0, 1), Radius=Slider(6, range=0..10))
extrude = Extrude(Base=circle_cnr, Direction=unit_z)
