# Grasshopper definition 1.3.2ConstructPoint.gh (Grasshopper 0.9.80)
# plug-ins: Bifocals

# PLAY with # sliders
number_slider = Slider(4, range=0..10)
construct_point = ConstructPoint(XCoordinate=Slider(5, range=0..10), YCoordinate=Slider(2, range=0..10), ZCoordinate=number_slider)
