# Grasshopper definition 1.3.2Line.gh (Grasshopper 0.9.80)
# plug-ins: Bifocals

# PLAY with # sliders
number_slider = Slider(8, range=0..10)
construct_point = ConstructPoint(XCoordinate=Slider(2, range=0..10), YCoordinate=Slider(4, range=0..10), ZCoordinate=Slider(7, range=0..10))
construct_point_2 = ConstructPoint(XCoordinate=Slider(5, range=0..10), YCoordinate=Slider(9, range=0..10), ZCoordinate=number_slider)
line = Line(StartPoint=construct_point, EndPoint=construct_point_2)
