# Grasshopper definition 1.5.3BoxMove.gh (Grasshopper 0.9.80)
# plug-ins: Bifocals

# Create a cube in Rhino using Box command
# 
# Set box into Geometry Node in Grasshopper
# 
# PLAY with the # slider
number_slider = Slider(13, range=0..100)
geometry = Geometry(<brep referenced from the Rhino model>)
unit_x = UnitX(Factor=number_slider)
move = Move(Geometry=geometry, Motion=unit_x)  # -> Geometry, Transform
