# Grasshopper definition 1.7.1Osnap.gh (Grasshopper 0.9.80)
# plug-ins: Bifocals

# ----
# PLAY with # sliders
number_slider = Slider(7, range=0..10)
construct_point = ConstructPoint(XCoordinate=number_slider, YCoordinate=Slider(5, range=0..10), ZCoordinate=Slider(0, range=0..10))
construct_point_2 = ConstructPoint(XCoordinate=Slider(6, range=0..10), YCoordinate=Slider(9, range=0..10), ZCoordinate=Slider(8, range=0..10))
line = Line(StartPoint=construct_point, EndPoint=construct_point_2)
point_on_curve = PointOnCurve(line, parameter=0.5)
construct_point_3 = ConstructPoint(XCoordinate=Slider(0, range=0..10), YCoordinate=Slider(5, range=0..10), ZCoordinate=Slider(7, range=0..10))
line_2 = Line(StartPoint=construct_point_3, EndPoint=point_on_curve)

# ----
# Create a curved line in Rhino
# Set Curve Node in Grasshopper to that Curve
# PLAY with # sliders
number_slider_2 = Slider(10, range=0..10)
curve = Curve(<curve referenced from the Rhino model>)
construct_point_4 = ConstructPoint(XCoordinate=Slider(0, range=0..10), YCoordinate=Slider(3, range=0..10), ZCoordinate=number_slider_2)
end_points = EndPoints(Curve=curve)  # -> Start, End
line_3 = Line(StartPoint=construct_point_4, EndPoint=end_points.Start)
line_4 = Line(StartPoint=construct_point_4, EndPoint=end_points.End)

# ----
# Create a Box in Rhino
# 
# Set Box to Geometry Node in Grasshopper
# 
# Notice the Volume centoid
geometry = Geometry(<brep referenced from the Rhino model>)
volume = Volume(Geometry=geometry)  # -> Volume, Centroid

# ----
# Create two circles in Rhino in two different locations
# 
# Set Curve Nodes in Grasshopper to those Curves repectively
# 
# PLAY with moving the circles in Rhino with the Gumball Widget
curve_2 = Curve(<curve referenced from the Rhino model>)
curve_3 = Curve(<curve referenced from the Rhino model>)
area = Area(Geometry=curve_3)  # -> Area, Centroid
area_2 = Area(Geometry=curve_2)  # -> Area, Centroid
line_5 = Line(StartPoint=area.Centroid, EndPoint=area_2.Centroid)
