# Grasshopper definition 1.7.2MergingData.gh (Grasshopper 0.9.80)
# plug-ins: Bifocals

# create a line in Rhino
# 
# Set line to Curve Node n Grasshopper
# 
# PLAY with #sliders
curve = Curve(<curve referenced from the Rhino model>)
construct_point = ConstructPoint(XCoordinate=Slider(6, range=0..10), YCoordinate=Slider(1, range=0..10), ZCoordinate=Slider(10, range=0..10))
end_points = EndPoints(Curve=curve)  # -> Start, End
merge = Merge(Data1=end_points.Start, Data2=end_points.End)
line = Line(StartPoint=construct_point, EndPoint=merge)
