# Grasshopper definition 1.7.3DividingCurve.gh (Grasshopper 0.9.80)
# plug-ins: Bifocals

# ----
# Set one Curve
# 
# PLAY with # slider
# 
# Check out the point order and display
number_slider = Slider(6, range=0..10)
curve = Curve(<curve referenced from the Rhino model>)
divide_curve = DivideCurve(Curve=curve, Count=number_slider, Kinks=False)  # -> Points, Tangents, Parameters
point_list = PointList(Points=divide_curve.Points, Size=Slider(4, range=0..10))
point_order = PointOrder(Points=divide_curve.Points)

# ----
# Create a Curve in Rhino
# 
# Set one Curve to Grasshopper Node
# 
# PLAY with # slider
# 
# and/or
# 
# move control points in original curve in Rhino
number_slider_2 = Slider(5, range=0..10)
curve_2 = Curve(<curve referenced from the Rhino model>)
divide_curve_2 = DivideCurve(Curve=curve_2, Count=number_slider_2, Kinks=False)  # -> Points, Tangents, Parameters
