# Grasshopper definition 1.7.4MovingObject.gh (Grasshopper 0.9.80)
# plug-ins: Bifocals

# Create a Box in Rhino
# 
# Set one Box
# 
# PLAY with # slider
# 
# Check out Vector Display
number_slider = Slider(10, range=0..10)
geometry = Geometry(<brep referenced from the Rhino model>)
unit_x = UnitX(Factor=number_slider)
volume = Volume(Geometry=geometry)  # -> Volume, Centroid
move = Move(Geometry=geometry, Motion=unit_x)  # -> Geometry, Transform
vector_display = VectorDisplay(Anchor=volume.Centroid, Vector=unit_x)
