# Grasshopper definition 2.1.1ListItem.gh (Grasshopper 0.9.80)
# plug-ins: Bifocals

# ----
# Create Two curves in Rhino
# 
# Set Two curves
# 
# PLAY with # sliders
number_slider = Slider(12, range=0..100)
curve = Curve(<curve referenced from the Rhino model>)
curve_2 = Curve(<curve referenced from the Rhino model>)
divide_curve = DivideCurve(Curve=curve, Count=number_slider, Kinks=False)  # -> Points, Tangents, Parameters
divide_curve_2 = DivideCurve(Curve=curve_2, Count=Slider(12, range=0..100), Kinks=False)  # -> Points, Tangents, Parameters
list_item = ListItem(List=divide_curve.Points, Index=Slider(1, range=0..1), Wrap=True)
list_item_2 = ListItem(List=divide_curve_2.Points, Index=Slider(6, range=0..10), Wrap=True)
line = Line(StartPoint=list_item, EndPoint=list_item_2)

# ----
# Set One Curve
# 
# PLAY
number_slider_2 = Slider(6, range=0..10)
curve_3 = Curve(<curve referenced from the Rhino model>)
divide_curve_3 = DivideCurve(Curve=curve_3, Count=number_slider_2, Kinks=False)  # -> Points, Tangents, Parameters
merge = Merge(Data1=Slider(1, range=0..1), Data2=Slider(4, range=0..10))
list_item_3 = ListItem(List=divide_curve_3.Points, Index=merge, Wrap=True)

# ----
# Set two curves
# 
# PLAY
number_slider_3 = Slider(6, range=0..10)
curve_4 = Curve(<curve referenced from the Rhino model>)
curve_5 = Curve(<curve referenced from the Rhino model>)
divide_curve_4 = DivideCurve(Curve=curve_4, Count=number_slider_3, Kinks=False)  # -> Points, Tangents, Parameters
divide_curve_5 = DivideCurve(Curve=curve_5, Count=Slider(4, range=0..10), Kinks=False)  # -> Points, Tangents, Parameters
merge_2 = Merge(Data1=Slider(1, range=0..1), Data2=Slider(4, range=0..10))
merge_3 = Merge(Data1=Slider(0, range=0..1), Data2=Slider(7, range=0..10))
list_item_4 = ListItem(List=divide_curve_4.Points, Index=merge_2, Wrap=True)
list_item_5 = ListItem(List=divide_curve_5.Points, Index=merge_3, Wrap=True)
line_2 = Line(StartPoint=list_item_4, EndPoint=list_item_5)

# ----
# Create 4 circles in Rhino
# 
# Set 4 circles to Geometry
# 
# PLAY
number_slider_4 = Slider(6, range=0..10)
geometry = Geometry([<curve referenced from the Rhino model> x4])
unit_z = UnitZ(Factor=Slider(12, range=0..100))
list_item_6 = ListItem(List=geometry, Index=number_slider_4, Wrap=True)
extrude = Extrude(Base=list_item_6, Direction=unit_z)
