# Grasshopper definition 2.1.2CullIndex.gh (Grasshopper 0.9.80)
# plug-ins: Bifocals

number_slider = Slider(5, range=0..100)
# Set Two Curves
# 
# PLAY
curve = Curve(<curve referenced from the Rhino model>)
curve_2 = Curve(<curve referenced from the Rhino model>)
divide_curve = DivideCurve(Curve=curve_2, Count=number_slider, Kinks=False)  # -> Points, Tangents, Parameters
number_slider_2 = Slider(3, range=0..10)
divide_curve_2 = DivideCurve(Curve=curve, Count=number_slider, Kinks=False)  # -> Points, Tangents, Parameters
cull_index = CullIndex(List=divide_curve.Points, Indices=number_slider_2, Wrap=True)
cull_index_2 = CullIndex(List=divide_curve_2.Points, Indices=number_slider_2, Wrap=True)
line = Line(StartPoint=cull_index, EndPoint=cull_index_2)
