# Grasshopper definition 2.1.3CullPattern.gh (Grasshopper 0.9.80)
# plug-ins: Bifocals

number_slider = Slider(12, range=0..100)
# Set Two Curves
# 
# PLAY
curve = Curve(<curve referenced from the Rhino model>)
curve_2 = Curve(<curve referenced from the Rhino model>)
divide_curve = DivideCurve(Curve=curve_2, Count=number_slider, Kinks=False)  # -> Points, Tangents, Parameters
divide_curve_2 = DivideCurve(Curve=curve, Count=number_slider, Kinks=False)  # -> Points, Tangents, Parameters
merge = Merge(Data1=Toggle(True), Data2=Toggle(False), Data3=Toggle(True), Data4=Toggle(False))
cull_pattern = CullPattern(List=divide_curve_2.Points, CullPattern=merge)
cull_pattern_2 = CullPattern(List=divide_curve.Points, CullPattern=merge)
line = Line(StartPoint=cull_pattern_2, EndPoint=cull_pattern)
