# Grasshopper definition 2.1.4ShiftList.gh (Grasshopper 0.9.80)
# plug-ins: Bifocals

# ----
# Set Two Curves
# 
# PLAY
# 
# * (connect line to cull index list at end of code and disable line preview)
number_slider = Slider(10, range=0..10)
curve = Curve(<curve referenced from the Rhino model>)
curve_2 = Curve(<curve referenced from the Rhino model>)
divide_curve = DivideCurve(Curve=curve, Count=number_slider, Kinks=False)  # -> Points, Tangents, Parameters
divide_curve_2 = DivideCurve(Curve=curve_2, Count=number_slider, Kinks=False)  # -> Points, Tangents, Parameters
shift_list = ShiftList(List=divide_curve.Points, Shift=Slider(1, range=0..10), Wrap=Toggle(True))
line = Line(StartPoint=divide_curve_2.Points, EndPoint=shift_list)
cull_index = CullIndex(Indices=number_slider, Wrap=True)

# ----
# Set One Curve
# 
# PLAY
number_slider_2 = Slider(9, range=0..100)
curve_3 = Curve()
divide_curve_3 = DivideCurve(Curve=curve_3, Count=number_slider_2, Kinks=False)  # -> Points, Tangents, Parameters
shift_list_2 = ShiftList(List=divide_curve_3.Points, Shift=Slider(4, range=0..10), Wrap=Toggle(False))
panel = Panel(divide_curve_3.Points)
panel_2 = Panel(shift_list_2)
