# Grasshopper definition 2.1.5SplitList.gh (Grasshopper 0.9.80)
# plug-ins: Bifocals

geometry = Geometry([<curve referenced from the Rhino model> x6])
# Create several circles in Rhino
# 
# Set multiple Geometry Node
# 
# PLAY
number_slider = Slider(7, range=0..100)
list_length = ListLength(List=geometry)
split_list = SplitList(List=geometry, Index=Slider(2, range=0..10))  # -> ListA, ListB
unit_z = UnitZ(Factor=Slider(12, range=0..100))
unit_z_2 = UnitZ(Factor=number_slider)
panel = Panel(list_length)
extrude = Extrude(Base=split_list.ListA, Direction=unit_z)
extrude_2 = Extrude(Base=split_list.ListB, Direction=unit_z_2)
list_length_2 = ListLength(List=extrude)
list_length_3 = ListLength(List=extrude_2)
panel_2 = Panel(list_length_2)
panel_3 = Panel(list_length_3)
