# Grasshopper definition 2.1.6ReverseList.gh (Grasshopper 0.9.80)
# plug-ins: Bifocals

number_slider = Slider(7, range=0..10)
curve = Curve(<curve referenced from the Rhino model>)
# Set Two Curves
# 
# PLAY
# 
# *(notice the effects of the reverse list node)
curve_2 = Curve(<curve referenced from the Rhino model>)
divide_curve = DivideCurve(Curve=curve_2, Count=number_slider, Kinks=False)  # -> Points, Tangents, Parameters
divide_curve_2 = DivideCurve(Curve=curve, Count=number_slider, Kinks=False)  # -> Points, Tangents, Parameters
number_slider_2 = Slider(2, range=0..10)
reverse_list = ReverseList(List=divide_curve_2.Points)
list_item = ListItem(List=divide_curve.Points, Index=number_slider_2, Wrap=True)
list_item_2 = ListItem(List=reverse_list, Index=number_slider_2, Wrap=True)
number_slider_3 = Slider(3, range=0..10)
line = Line(StartPoint=list_item_2, EndPoint=list_item)
point_list = PointList(Points=divide_curve_2.Points, Size=number_slider_3)
point_list_2 = PointList(Points=divide_curve.Points, Size=number_slider_3)
