# Grasshopper definition 2.1Fliters.gh (Grasshopper 0.9.80)
# plug-ins: Bifocals

number_slider = Slider(5, range=0..10)
# Create two curves in Rhino
# 
# Set Two curves
# 
# PLAY with # sliders
curve = Curve(<curve referenced from the Rhino model>)
curve_2 = Curve(<curve referenced from the Rhino model>)
divide_curve = DivideCurve(Curve=curve, Count=number_slider, Kinks=False)  # -> Points, Tangents, Parameters
divide_curve_2 = DivideCurve(Curve=curve_2, Count=number_slider, Kinks=False)  # -> Points, Tangents, Parameters
number_slider_2 = Slider(2, range=0..10)
line = Line(StartPoint=divide_curve_2.Points, EndPoint=divide_curve.Points)
point_list = PointList(Points=divide_curve.Points, Size=number_slider_2)
point_list_2 = PointList(Points=divide_curve_2.Points, Size=number_slider_2)
