# Grasshopper definition 2.2.1Series.gh (Grasshopper 0.9.80)
# plug-ins: Bifocals

# ----
# PLAY
number_slider = Slider(1, range=0..10)
series = Series(Start=number_slider, Step=Slider(4, range=0..10), Count=Slider(7, range=0..10))
panel = Panel(series)

# ----
# Create a box in Rhino
# 
# Set one Geometry
# 
# PLAY
number_slider_2 = Slider(0, range=0..10)
geometry = Geometry(<brep referenced from the Rhino model>)
series_2 = Series(Start=number_slider_2, Step=Slider(3, range=0..10), Count=Slider(7, range=0..10))
unit_x = UnitX(Factor=series_2)
panel_2 = Panel(series_2)
move = Move(Geometry=geometry, Motion=unit_x)  # -> Geometry, Transform
