# Grasshopper definition 2.2.2DataMatching.gh (Grasshopper 0.9.80)
# plug-ins: Bifocals

# ----
# Swap out Wires from Cross refference Node
# Create a box in Rhino
# 
# Set one Geometry
# 
# PLAY
# 
# * (The Crossreference Node is a Data Matching tool, like Shortest List Node and Longest List Node)
number_slider = Slider(1, range=0..10)
geometry = Geometry(<brep referenced from the Rhino model>)
series = Series(Start=number_slider, Step=Slider(4, range=0..10), Count=Slider(7, range=0..10))
series_2 = Series(Start=Slider(1, range=0..10), Step=Slider(4, range=0..10), Count=Slider(7, range=0..10))
unit_y = UnitY(Factor=series)
unit_x = UnitX(Factor=series_2)
move = Move(Geometry=geometry, Motion=unit_x)  # -> Geometry, Transform
panel = Panel(unit_y)
cross_reference = CrossReference(ListListA=move.Geometry, ListListB=unit_y, CrossMode=1)  # -> ListListA, ListListB
longest_list = LongestList(PaddingMode=2)  # -> ListListA, ListListB
shortest_list = ShortestList(TrimMode=2)  # -> ListListA, ListListB
panel_2 = Panel(move.Geometry)
move_2 = Move(Geometry=cross_reference.ListListA, Motion=cross_reference.ListListB)  # -> Geometry, Transform

# ----
# Create a box in Rhino
# 
# Set one Geometry
# 
# PLAY
number_slider_2 = Slider(0, range=0..10)
geometry_2 = Geometry(<brep referenced from the Rhino model>)
series_3 = Series(Start=number_slider_2, Step=Slider(9, range=0..10), Count=Slider(5, range=0..10))
series_4 = Series(Start=Slider(0, range=0..10), Step=Slider(10, range=0..10), Count=Slider(4, range=0..10))
unit_y_2 = UnitY(Factor=series_3)
unit_x_2 = UnitX(Factor=series_4)
series_5 = Series(Start=Slider(0, range=0..10), Step=Slider(10, range=0..10), Count=Slider(3, range=0..10))
move_3 = Move(Geometry=geometry_2, Motion=unit_x_2)  # -> Geometry, Transform
unit_z = UnitZ(Factor=series_5)
cross_reference_2 = CrossReference(ListListA=move_3.Geometry, ListListB=unit_y_2, CrossMode=1)  # -> ListListA, ListListB
move_4 = Move(Geometry=cross_reference_2.ListListA, Motion=cross_reference_2.ListListB)  # -> Geometry, Transform
cross_reference_3 = CrossReference(ListListA=move_4.Geometry, ListListB=unit_z, CrossMode=1)  # -> ListListA, ListListB
move_5 = Move(Geometry=cross_reference_3.ListListA, Motion=cross_reference_3.ListListB)  # -> Geometry, Transform

# ----
# Create a box in Rhino
# 
# Set one Geometry
# 
# PLAY
number_slider_3 = Slider(1, range=0..10)
geometry_3 = Geometry(<brep referenced from the Rhino model>)
series_6 = Series(Start=number_slider_3, Step=Slider(4, range=0..10), Count=Slider(7, range=0..10))
series_7 = Series(Start=Slider(1, range=0..10), Step=Slider(4, range=0..10), Count=Slider(7, range=0..10))
unit_y_3 = UnitY(Factor=series_6)
unit_x_3 = UnitX(Factor=series_7)
move_6 = Move(Geometry=geometry_3, Motion=unit_x_3)  # -> Geometry, Transform
panel_3 = Panel(unit_y_3)
move_7 = Move(Geometry=move_6.Geometry, Motion=unit_y_3)  # -> Geometry, Transform
panel_4 = Panel(move_6.Geometry)
