# Grasshopper definition 2.2.4RandomConstructDomain.gh (Grasshopper 0.9.80)
# plug-ins: Bifocals

construct_domain = ConstructDomain(DomainStart=Slider(2, range=0..10), DomainEnd=Slider(2, range=0..10))
random = Random(Range=construct_domain, Number=Slider(5, range=0..10), Seed=2)
panel = Panel(random)
