# Grasshopper definition 2.2.4Range.gh (Grasshopper 0.9.80)
# plug-ins: Bifocals

construct_domain = ConstructDomain(DomainStart=Slider(2, range=0..10), DomainEnd=Slider(8, range=0..10))
range = Range(Domain=construct_domain, Steps=Slider(5, range=0..10))
panel = Panel(range)
