# Grasshopper definition 2.3.1FunctionsOneVariable.gh (Grasshopper 0.9.80)
# plug-ins: Bifocals

# Functions are a Bit more difficult to understand!
# 
# 1. you must set your variable names to the exact variable you are using in your panel
# 
# 2.  you must unselect multiline data in your panel to set data into panel index
number_slider = Slider(2, range=0..10)
construct_domain = ConstructDomain(DomainStart=Slider(-2, range=-2..10), DomainEnd=number_slider)
range = Range(Domain=construct_domain, Steps=Slider(10, range=0..10))
evaluate = Evaluate(Expression="x^2", x=range)
construct_point = ConstructPoint(XCoordinate=range, YCoordinate=evaluate, ZCoordinate=0)
panel = Panel(range)
interpolate = Interpolate(Vertices=construct_point, Degree=3, Periodic=False, KnotStyle=1)  # -> Curve, Length, Domain
panel_2 = Panel(evaluate)
