# Grasshopper definition 2.3.2Functions2Variable.gh (Grasshopper 0.9.80)
# plug-ins: Bifocals

# Getting Tricky!
# 
# 1.  Check your variables x & y in the expression node and panel
# 
# 2.  deselect multiline in panel
# 
# PLAY
number_slider = Slider(2, range=0..10)
number_slider_2 = Slider(10, range=0..10)
construct_domain = ConstructDomain(DomainStart=Slider(-2, range=-2..10), DomainEnd=Slider(2, range=0..10))
construct_domain_2 = ConstructDomain(DomainStart=Slider(-2, range=-2..10), DomainEnd=1)
range = Range(Domain=construct_domain, Steps=number_slider_2)
range_2 = Range(Domain=construct_domain_2, Steps=number_slider_2)
cross_reference = CrossReference(ListA=range, ListB=range_2, CrossMode=1)  # -> ListA, ListB
evaluate = Evaluate(Expression="-((x^2+y^2)/4)+4", x=cross_reference.ListA, y=cross_reference.ListB)
construct_point = ConstructPoint(XCoordinate=cross_reference.ListA, YCoordinate=cross_reference.ListB, ZCoordinate=evaluate)
list_length = ListLength(List=range_2)
surface_from_points = SurfaceFromPoints(Points=construct_point, UCount=list_length, Interpolate=False)
