# Grasshopper definition 2.4.1bBooleanValues.gh (Grasshopper 0.9.80)
# plug-ins: Bifocals

# ----
# create several circles in Rhino, some with radius > 2, and some with radius < 2
# 
# Set circles into curve in grasshopper
# 
# reset you variables in function and deselect multiline data in panel
curve = Curve([<curve referenced from the Rhino model> x8])
deconstruct_arc = DeconstructArc(Arc=curve)  # -> BasePlane, Radius, Angle
evaluate = Evaluate(Expression="x>2", x=deconstruct_arc.Radius)
panel = Panel(deconstruct_arc.Radius)
unit_z = UnitZ(Factor=Slider(12, range=0..100))
cull_pattern = CullPattern(List=curve, CullPattern=evaluate)
panel_2 = Panel(evaluate)
extrude = Extrude(Base=cull_pattern, Direction=unit_z)

# ----
# Deactivate script above
# 
# substitue dispatch node for cull pattern
# 
# extrude each dispatch group to a different hieight
curve_2 = Curve([<curve referenced from the Rhino model> x8])
deconstruct_arc_2 = DeconstructArc(Arc=curve_2)  # -> BasePlane, Radius, Angle
evaluate_2 = Evaluate(Expression="x>2", x=deconstruct_arc_2.Radius)
panel_3 = Panel(deconstruct_arc_2.Radius)
unit_z_2 = UnitZ(Factor=Slider(4, range=0..100))
unit_z_3 = UnitZ(Factor=Slider(17, range=0..100))
dispatch = Dispatch(List=curve_2, DispatchPattern=evaluate_2)  # -> ListA, ListB
panel_4 = Panel(evaluate_2)
extrude_2 = Extrude(Base=dispatch.ListA, Direction=unit_z_3)
extrude_3 = Extrude(Base=dispatch.ListB, Direction=unit_z_2)

# ----
# Deactivate script above
# 
# substitute Concatinate Node for # slider
curve_3 = Curve([<curve referenced from the Rhino model> x8])
deconstruct_arc_3 = DeconstructArc(Arc=curve_3)  # -> BasePlane, Radius, Angle
concatenate = Concatenate(FragmentA="x>", FragmentB=Slider(2, range=0..10))
evaluate_3 = Evaluate(Expression=concatenate, x=deconstruct_arc_3.Radius)
unit_z_4 = UnitZ(Factor=Slider(4, range=0..100))
unit_z_5 = UnitZ(Factor=Slider(17, range=0..100))
dispatch_2 = Dispatch(List=curve_3, DispatchPattern=evaluate_3)  # -> ListA, ListB
panel_5 = Panel(concatenate)
extrude_4 = Extrude(Base=dispatch_2.ListA, Direction=unit_z_5)
extrude_5 = Extrude(Base=dispatch_2.ListB, Direction=unit_z_4)

concatenate_2 = Concatenate(FragmentA="the cat", FragmentB="is on the table")
concatenate_3 = Concatenate(FragmentA="x>", FragmentB=Slider(4, range=0..10))
panel_6 = Panel(concatenate_2)
panel_7 = Panel(concatenate_3)
