# Grasshopper definition 2.5.1AtractorsCircle.gh (Grasshopper 0.9.80)
# plug-ins: Bifocals

number_slider = Slider(0.92, range=0..2)
# Create one point in Rhino
# 
# Set point in Grasshopper as the Attractor
# 
# *Distance/Bounds/Construct Domain MIN &MAX/Remap
# 
# Set U Count of Surface from Points Node
# 
# Set Limit with Minimum Node
number_slider_2 = Slider(17, range=0..100)
multiplication = Multiplication(A=number_slider, B="2")
series = Series(Start=0, Step=multiplication, Count=number_slider_2)

circle = Circle(Plane=PlaneXY(0, 0, 0), Radius=number_slider)

unit_x = UnitX(Factor=series)
series_2 = Series(Start=0, Step=multiplication, Count=number_slider_2)
move = Move(Geometry=circle, Motion=unit_x)  # -> Geometry, Transform
unit_y = UnitY(Factor=series_2)
cross_reference = CrossReference(ListListA=move.Geometry, ListListB=unit_y, CrossMode=1)  # -> ListListA, ListListB
move_2 = Move(Geometry=cross_reference.ListListA, Motion=cross_reference.ListListB)  # -> Geometry, Transform

point = Point(<point referenced from the Rhino model>)

area = Area(Geometry=move_2.Geometry)  # -> Area, Centroid
distance = Distance(PointA=area.Centroid, PointB=point)
circle_2 = Circle(Plane=PlaneXY(0, 0, 0), Radius=point)
division = Division(A=distance, B=Slider(25, range=0..100))

# ----
# Sets a Limit to Scale Factor with Minimum Node
number_slider_3 = Slider(0.7, range=0..1)
minimum = Minimum(A=division, B=number_slider_3)

scale = Scale(Geometry=move_2.Geometry, Center=area.Centroid, Factor=minimum)  # -> Geometry, Transform
boundary_surfaces = BoundarySurfaces(Edges=scale.Geometry)
