# Grasshopper definition 2.5.1AttractorsCurve.gh (Grasshopper 0.9.80)
# plug-ins: Bifocals

number_slider = Slider(0.92, range=0..2)
# Create one curve in Rhino
# 
# Set curve in Grasshopper as the Attractor
# 
# *Distance/Bounds/Construct Domain/Remap
number_slider_2 = Slider(19, range=0..100)
multiplication = Multiplication(A=number_slider, B="2")
series = Series(Start=0, Step=multiplication, Count=number_slider_2)
unit_x = UnitX(Factor=series)

circle = Circle(Plane=PlaneXY(0, 0, 0), Radius=number_slider)

series_2 = Series(Start=0, Step=multiplication, Count=number_slider_2)

curve = Curve(<curve referenced from the Rhino model>)

move = Move(Geometry=circle, Motion=unit_x)  # -> Geometry, Transform
unit_y = UnitY(Factor=series_2)
cross_reference = CrossReference(ListA=move.Geometry, ListB=unit_y, CrossMode=1)  # -> ListA, ListB
move_2 = Move(Geometry=cross_reference.ListA, Motion=cross_reference.ListB)  # -> Geometry, Transform
area = Area(Geometry=move_2.Geometry)  # -> Area, Centroid
curve_closest_point = CurveClosestPoint(Point=area.Centroid, Curve=curve)  # -> Point, Parameter, Distance
construct_domain = ConstructDomain(DomainStart=Slider(0.08, range=0..1), DomainEnd=Slider(1, range=0..1))
bounds = Bounds(Numbers=curve_closest_point.Distance)
panel = Panel(construct_domain)
panel_2 = Panel(bounds)
remap_numbers = RemapNumbers(Value=curve_closest_point.Distance, Source=bounds, Target=construct_domain)  # -> Mapped, Clipped
scale = Scale(Geometry=move_2.Geometry, Center=area.Centroid, Factor=remap_numbers.Mapped)  # -> Geometry, Transform
param_viewer = ParamViewer(remap_numbers.Mapped)
panel_3 = Panel(remap_numbers.Mapped)
boundary_surfaces = BoundarySurfaces(Edges=scale.Geometry)
gradient = Gradient(
    LowerLimit=0,
    UpperLimit=1,
    Parameter=remap_numbers.Mapped,
    stops=[0: RGB(234, 38, 0), 0.25: RGB(234, 126, 0), 0.359: RGB(254, 244, 84), 0.477: RGB(173, 203, 249), 1: RGB(75, 107, 169)])
custom_preview = CustomPreview(Geometry=boundary_surfaces, Shader=gradient)
