# Grasshopper definition 2.5.1AttractorsCurveReversed.gh (Grasshopper 0.9.80)
# plug-ins: Bifocals

number_slider = Slider(0.92, range=0..2)
# Create one curve in Rhino
# 
# Set curve in Grasshopper as the Attractor
# 
# *Distance/Bounds/Construct Domain MIN &MAX/Remap
# 
# Set U Count of Surface from Points Node
number_slider_2 = Slider(17, range=0..100)
multiplication = Multiplication(A=number_slider, B="2")
series = Series(Start=0, Step=multiplication, Count=number_slider_2)
unit_x = UnitX(Factor=series)

circle = Circle(Plane=PlaneXY(0, 0, 0), Radius=number_slider)

series_2 = Series(Start=0, Step=multiplication, Count=number_slider_2)

curve = Curve(<curve referenced from the Rhino model>)

move = Move(Geometry=circle, Motion=unit_x)  # -> Geometry, Transform
unit_y = UnitY(Factor=series_2)
cross_reference = CrossReference(ListListA=move.Geometry, ListListB=unit_y, CrossMode=1)  # -> ListListA, ListListB
move_2 = Move(Geometry=cross_reference.ListListA, Motion=cross_reference.ListListB)  # -> Geometry, Transform
number_slider_3 = Slider(0.03, range=0..1)
number_slider_4 = Slider(0.97, range=0..1)
area = Area(Geometry=move_2.Geometry)  # -> Area, Centroid
curve_closest_point = CurveClosestPoint(Point=area.Centroid, Curve=curve)  # -> Point, Parameter, Distance

construct_domain = ConstructDomain(DomainStart=number_slider_3, DomainEnd=number_slider_4)
# Switch Me out with Remap
construct_domain_2 = ConstructDomain(DomainStart=number_slider_4, DomainEnd=number_slider_3)

bounds = Bounds(Numbers=curve_closest_point.Distance)
panel = Panel(bounds)
remap_numbers = RemapNumbers(Value=curve_closest_point.Distance, Source=bounds, Target=construct_domain_2)  # -> Mapped, Clipped
scale = Scale(Geometry=move_2.Geometry, Center=area.Centroid, Factor=remap_numbers.Mapped)  # -> Geometry, Transform
boundary_surfaces = BoundarySurfaces(Edges=scale.Geometry)
