# Grasshopper definition 2.5.1AttractorsCurveZaxis.gh (Grasshopper 0.9.80)
# plug-ins: Bifocals

number_slider = Slider(0.92, range=0..2)
# Create one curve in Rhino
# 
# Set curve in Grasshopper as the Attractor
# 
# *Distance/Bounds/Construct Domain MIN &MAX/Remap
# 
# Set U Count of Surface from Points Node
number_slider_2 = Slider(17, range=0..100)
multiplication = Multiplication(A=number_slider, B="2")
series = Series(Start=0, Step=multiplication, Count=number_slider_2)
unit_x = UnitX(Factor=series)

circle = Circle(Plane=PlaneXY(0, 0, 0), Radius=number_slider)

series_2 = Series(Start=0, Step=multiplication, Count=number_slider_2)

curve = Curve(<curve referenced from the Rhino model>)

move = Move(Geometry=circle, Motion=unit_x)  # -> Geometry, Transform
unit_y = UnitY(Factor=series_2)
cross_reference = CrossReference(ListA=move.Geometry, ListB=unit_y, CrossMode=1)  # -> ListA, ListB
move_2 = Move(Geometry=cross_reference.ListA, Motion=cross_reference.ListB)  # -> Geometry, Transform
area = Area(Geometry=move_2.Geometry)  # -> Area, Centroid
curve_closest_point = CurveClosestPoint(Point=area.Centroid, Curve=curve)  # -> Point, Parameter, Distance
construct_domain = ConstructDomain(DomainStart=Slider(0, range=0..10), DomainEnd=Slider(33, range=0..100))
bounds = Bounds(Numbers=curve_closest_point.Distance)
panel = Panel(construct_domain)
panel_2 = Panel(bounds)
remap_numbers = RemapNumbers(Value=curve_closest_point.Distance, Source=bounds, Target=construct_domain)  # -> Mapped, Clipped
unit_z = UnitZ(Factor=remap_numbers.Mapped)
move_3 = Move(Geometry=area.Centroid, Motion=unit_z)  # -> Geometry, Transform

surface_from_points = SurfaceFromPoints(Points=move_3.Geometry, UCount=number_slider_2, Interpolate=False)
