# Grasshopper definition 2.5RemappingNumbers.gh (Grasshopper 0.9.80)
# plug-ins: Bifocals

# Remapping from 0 to 1
number_slider = Slider(1, range=0..1)
series = Series(Start=Slider(2, range=0..10), Step=Slider(2, range=0..10), Count=Slider(4, range=0..10))
panel = Panel(series)
construct_domain = ConstructDomain(DomainStart=Slider(0, range=0..1), DomainEnd=number_slider)
bounds = Bounds(Numbers=series)
remap_numbers = RemapNumbers(Value=series, Source=bounds, Target=construct_domain)  # -> Mapped, Clipped
panel_2 = Panel(bounds)
panel_3 = Panel(construct_domain)
panel_4 = Panel(remap_numbers.Mapped)
