# Grasshopper definition 3.3.2InvertingDirection.gh (Grasshopper 0.9.80)
# plug-ins: Bifocals

# Set Two curves in Rhino in reverse directions
number_slider = Slider(0, range=0..1)
curve = Curve(reparameterize(<curve referenced from the Rhino model>))
curve_2 = Curve(reparameterize(<curve referenced from the Rhino model>))
flip_curve = FlipCurve(Curve=curve_2)  # -> Curve, Flag
evaluate_curve = EvaluateCurve(Curve=[curve, flip_curve.Curve], Parameter=number_slider)  # -> Point, Tangent, Angle
list_item = ListItem(List=evaluate_curve.Point, Index=0, Wrap=Slider(0, range=0..100))
list_item_2 = ListItem(List=evaluate_curve.Point, Index=Slider(1, range=0..1), Wrap=True)
line = Line(StartPoint=list_item, EndPoint=list_item_2)
