# Grasshopper definition 3.3.3PointsonCurveCP.gh (Grasshopper 0.9.80)
# plug-ins: Bifocals

curve = Curve()
point = Point()
curve_2 = Curve()
curve_3 = Curve()
curve_4 = Curve()
curve_5 = Curve()
curve_closest_point = CurveClosestPoint(Point=point, Curve=curve)  # -> Point, Parameter, Distance
evaluate_length = EvaluateLength(Curve=curve_2, Length=Slider(12, range=0..100), Normalized=Toggle(False))  # -> Point, Tangent, Parameter
divide_curve = DivideCurve(Curve=curve_3, Count=Slider(5, range=0..10), Kinks=False)  # -> Points, Tangents, Parameters
divide_length = DivideLength(Curve=curve_5, Length=Slider(5, range=0..10))  # -> Points, Tangents, Parameters
divide_distance = DivideDistance(Distance=Slider(5, range=0..10))  # -> Points, Tangents, Parameters
list_length = ListLength(List=curve_2)
panel = Panel(curve_closest_point.Parameter)
panel_2 = Panel(curve_closest_point.Point)
panel_3 = Panel(list_length)
panel_4 = Panel(evaluate_length.Parameter)
panel_5 = Panel(evaluate_length.Point)
panel_6 = Panel(divide_curve.Parameters)
panel_7 = Panel(divide_distance.Parameters)
panel_8 = Panel(divide_length.Parameters)

number_slider = Slider(0.3, range=0..1)
# Shatter!
number_slider_2 = Slider(5, range=0..10)
curve_6 = Curve()
curve_7 = Curve()
curve_8 = Curve()
point_2 = Point()
curve_closest_point_2 = CurveClosestPoint(Point=point_2, Curve=curve_6)  # -> Point, Parameter, Distance
evaluate_curve = EvaluateCurve(Curve=curve_7, Parameter=number_slider)  # -> Point, Tangent, Angle
shatter = Shatter(Curve=curve_7, Parameters=number_slider)
divide_curve_2 = DivideCurve(Curve=curve_8, Count=number_slider_2, Kinks=False)  # -> Points, Tangents, Parameters
shatter_2 = Shatter(Curve=curve_6, Parameters=curve_closest_point_2.Parameter)
shatter_3 = Shatter(Curve=curve_8, Parameters=divide_curve_2.Parameters)
panel_9 = Panel(shatter)
panel_10 = Panel(shatter_2)
panel_11 = Panel(shatter_3)
