# Grasshopper definition 3.3AnalysisCurves.gh (Grasshopper 0.9.80)
# plug-ins: Bifocals

curve = Curve(reparameterize(<curve referenced from the Rhino model>))
curve_2 = Curve(reparameterize(<curve referenced from the Rhino model>))
curve_3 = Curve(reparameterize(<curve referenced from the Rhino model>))
curve_4 = Curve(reparameterize(<curve referenced from the Rhino model>))
# Check out what Guide on Flip Curve Does
number_slider = Slider(23, range=0..100)
merge = Merge(Data1=curve, Data2=curve_4, Data3=curve_2, Data4=curve_3)
flip_curve = FlipCurve(Curve=merge, Guide=curve_3)  # -> Curve, Flag
evaluate_curve = EvaluateCurve(Curve=flip_curve.Curve, Parameter=Slider(0, range=0..1))  # -> Point, Tangent, Angle
multiplication = Multiplication(A=evaluate_curve.Tangent, B=number_slider)
vector_display = VectorDisplay(Anchor=evaluate_curve.Point, Vector=multiplication)

curve_5 = Curve(reparameterize(<curve referenced from the Rhino model>))
evaluate_curve_2 = EvaluateCurve(Curve=curve_5, Parameter=Slider(0.11, range=0..1))  # -> Point, Tangent, Angle
multiplication_2 = Multiplication(A=evaluate_curve_2.Tangent, B=Slider(23, range=0..100))
vector_display_2 = VectorDisplay(Anchor=evaluate_curve_2.Point, Vector=multiplication_2)
