# Grasshopper definition 3.4Curvature.gh (Grasshopper 0.9.80)
# plug-ins: Bifocals

curve = Curve(reparameterize(<curve referenced from the Rhino model>))
curvature = Curvature(Curve=curve, Parameter=Slider(0.2, range=0..1))  # -> Point, Curvature, Curvature_2
deconstruct_arc = DeconstructArc(Arc=curvature.Curvature_2)  # -> BasePlane, Radius, Angle
vector_length = VectorLength(Vector=curvature.Curvature)
vector_display = VectorDisplay(Anchor=curvature.Point, Vector=curvature.Curvature)
division = Division(A=Slider(1, range=0..1), B=deconstruct_arc.Radius)
panel = Panel(division)
panel_2 = Panel(vector_length)
