# Grasshopper definition 3.6SurfaceCreation.gh (Grasshopper 0.9.80)
# plug-ins: Bifocals

# Edge Surface
# 
# Patch
# 
# Network Surface
# 
# Sweep 1 and 2
# 
# Revolution
# 
# Rail Revolution
number_slider = Slider(6, range=0..10)
curve = Curve()
point = Point()
boundary_surfaces = BoundarySurfaces(Edges=curve)
surface_from_points = SurfaceFromPoints(Points=point, UCount=number_slider, Interpolate=False)
