# Grasshopper definition 3.7.10Diagrid.gh (Grasshopper 0.9.80)
# plug-ins: Bifocals

number_slider = Slider(24, range=0..100)
surface = Surface(reparameterize(<surface referenced from the Rhino model>))
divide_domain² = DivideDomain²(Domain=surface, UCount=number_slider, VCount=number_slider)
isotrim = Isotrim(Surface=surface, Domain=divide_domain²)
deconstruct_brep = DeconstructBrep(Brep=isotrim)  # -> Faces, Edges, Vertices
list_item = ListItem(List=deconstruct_brep.Vertices, Index=Slider(0, range=0..1), Wrap=True)
list_item_2 = ListItem(List=deconstruct_brep.Vertices, Index=Slider(1, range=0..1), Wrap=True)
list_item_3 = ListItem(List=deconstruct_brep.Vertices, Index=Slider(2, range=0..10), Wrap=True)
list_item_4 = ListItem(List=deconstruct_brep.Vertices, Index=Slider(3, range=0..10), Wrap=True)
line = Line(StartPoint=list_item_2, EndPoint=list_item_4)
line_2 = Line(StartPoint=list_item, EndPoint=list_item_3)

number_slider_2 = Slider(12, range=0..100)
divide_domain²_2 = DivideDomain²(UCount=number_slider_2, VCount=number_slider_2)
isotrim_2 = Isotrim(Domain=divide_domain²_2)
list_item_5 = ListItem(List=isotrim_2, Index=Slider(0, range=0..100), Wrap=True)
deconstruct_brep_2 = DeconstructBrep(Brep=list_item_5)  # -> Faces, Edges, Vertices
list_item_6 = ListItem(List=deconstruct_brep_2.Vertices, Index=Slider(0, range=0..1), Wrap=True)
list_item_7 = ListItem(List=deconstruct_brep_2.Vertices, Index=Slider(1, range=0..1), Wrap=True)
list_item_8 = ListItem(List=deconstruct_brep_2.Vertices, Index=Slider(2, range=0..10), Wrap=True)
list_item_9 = ListItem(List=deconstruct_brep_2.Vertices, Index=Slider(3, range=0..10), Wrap=True)
line_3 = Line(StartPoint=list_item_7, EndPoint=list_item_9)
line_4 = Line(StartPoint=list_item_6, EndPoint=list_item_8)

surface_2 = Surface()
surface_3 = Surface(reparameterize(<surface referenced from the Rhino model>))
deconstruct_brep_3 = DeconstructBrep(Brep=surface_2)  # -> Faces, Edges, Vertices
panel = Panel(deconstruct_brep_3.Faces)
panel_2 = Panel(deconstruct_brep_3.Edges)
panel_3 = Panel(deconstruct_brep_3.Vertices)

surface_4 = Surface(surface)
project = Project(Curve=line_2, Brep=surface_4, Direction=Vector(0, 0, 1))
project_2 = Project(Curve=line, Brep=surface_4, Direction=Vector(0, 0, 1))
pipe = Pipe(Curve=[project, project_2], Radius=Slider(0.75, range=0..1), Caps=0)
