# Grasshopper definition 3.7.2FindingPointsonSurface.gh (Grasshopper 0.9.80)
# plug-ins: Bifocals

surface = Surface()
point = Point()
surface_closest_point = SurfaceClosestPoint(Point=point, Surface=surface)  # -> Point, UVPoint, Distance
panel = Panel(surface_closest_point.Point)
panel_2 = Panel(surface_closest_point.UVPoint)
