# Grasshopper definition 3.7.5DividingSurface.gh (Grasshopper 0.9.80)
# plug-ins: Bifocals

surface = Surface(reparameterize(<surface referenced from the Rhino model>))
divide_surface = DivideSurface(Surface=surface, UCount=Slider(5, range=0..10), VCount=Slider(5, range=0..10))  # -> Points, Normals, Parameters
