# Grasshopper definition 3.7.6SplittingSurface.gh (Grasshopper 0.9.80)
# plug-ins: Bifocals

surface = Surface()
surface_2 = Surface(reparameterize(<surface referenced from the Rhino model>))
surface_3 = Surface(reparameterize(<surface referenced from the Rhino model>))
divide_domain² = DivideDomain²(Domain=surface, UCount=Slider(4, range=0..10), VCount=Slider(2, range=0..10))
divide_domain²_2 = DivideDomain²(Domain=surface_2, UCount=Slider(4, range=0..10), VCount=Slider(2, range=0..10))
divide_domain²_3 = DivideDomain²(Domain=surface_3, UCount=Slider(7, range=0..10), VCount=Slider(3, range=0..10))
md_slider = MDSlider(
    slider_value=Point(0.8902439024, 0.7682926829, 0.5),
    SliderMode=0,
    x_domain=Domain(0, 1),
    y_domain=Domain(0, 1),
    z_domain=Domain(0, 1))
isotrim = Isotrim(Surface=surface, Domain=divide_domain²)

# ----
# It is possible to Reparamatize each sub-surface
isotrim_2 = Isotrim(Surface=surface_2, Domain=divide_domain²_2)  # -> reparameterize(Surface)

isotrim_3 = Isotrim(Surface=surface_3, Domain=divide_domain²_3)

merge = Merge(Data1=Toggle(False), Data2=Toggle(True), Data3=Toggle(True), Data4=Toggle(True))
panel = Panel(isotrim)
list_item = ListItem(List=isotrim_2, Index=Slider(1, range=0..1), Wrap=True)
cull_pattern = CullPattern(List=isotrim_3, CullPattern=merge)
evaluate_surface = EvaluateSurface(Surface=list_item, Point=md_slider)  # -> Point, Normal, Frame
