# Grasshopper definition 3.7.7StrategyEvenSplitting.gh (Grasshopper 0.9.80)
# plug-ins: Bifocals

surface = Surface(reparameterize(<surface referenced from the Rhino model>))
divide_domain² = DivideDomain²(Domain=surface, UCount=Slider(12, range=0..100), VCount=Slider(3, range=0..100))
deconstruct_domain² = DeconstructDomain²(Domain=divide_domain²)  # -> UComponent, VComponent
graph_mapper = GraphMapper(
    deconstruct_domain².UComponent,
    x0=0,
    x1=1,
    y0=0,
    y1=1,
    container_name="Bezier",
    cpx=[0, 0.1086956486, 0.8985507488, 1],
    cpy=[0, 0.5652173758, 0.4637681246, 1])
graph_mapper_2 = GraphMapper(
    deconstruct_domain².VComponent,
    x0=0,
    x1=1,
    y0=0,
    y1=1,
    container_name="Bezier",
    cpx=[0, 0.586956501, 0.5797101259, 1],
    cpy=[0, 0.1014492512, 0.789855063, 1])
construct_domain² = ConstructDomain²(DomainU=graph_mapper, DomainV=graph_mapper_2)
isotrim = Isotrim(Surface=surface, Domain=construct_domain²)  # -> reparameterize(Surface)
