# Grasshopper definition 3.7AnalysisSurface.gh (Grasshopper 0.9.80)
# plug-ins: Bifocals

md_slider = MDSlider(
    slider_value=Point(0.5609756098, 0.4817073171, 0.5),
    SliderMode=0,
    x_domain=Domain(0, 1),
    y_domain=Domain(0, 1),
    z_domain=Domain(0, 1))
md_slider_2 = MDSlider(
    slider_value=Point(0.5609756098, 0.4817073171, 0.5),
    SliderMode=0,
    x_domain=Domain(0, 1),
    y_domain=Domain(0, 1),
    z_domain=Domain(0, 1))
surface = Surface()
surface_2 = Surface()
evaluate_surface = EvaluateSurface(Surface=surface, Point=md_slider)  # -> Point, Normal, Frame
evaluate_surface_2 = EvaluateSurface(Surface=surface_2, Point=md_slider_2)  # -> Point, Normal, Frame
point = Point(evaluate_surface.Point)
multiplication = Multiplication(A=evaluate_surface_2.Normal, B=Slider(12, range=0..100))
panel = Panel(point)
vector_display = VectorDisplay(Anchor=evaluate_surface_2.Point, Vector=multiplication)
