# Grasshopper definition 3.8.1GaussianCirvature.gh (Grasshopper 0.9.80)
# plug-ins: Bifocals

md_slider = MDSlider(slider_value=Point(0.588, 0.5, 0.5), SliderMode=0, x_domain=Domain(0, 1), y_domain=Domain(0, 1), z_domain=Domain(0, 1))
surface = Surface(reparameterize(<surface referenced from the Rhino model>))
surface_curvature = SurfaceCurvature(Surface=surface, Point=md_slider)  # -> Frame, Gaussian, Mean
principal_curvature = PrincipalCurvature(Surface=surface, Point=md_slider)  # -> Frame, Min, Max, MinDirection, MaxDirection
point = Point(principal_curvature.Frame)
amplitude = Amplitude(Vector=[principal_curvature.MinDirection, principal_curvature.MaxDirection], Amplitude=Slider(48, range=0..100))
panel = Panel(surface_curvature.Gaussian)
panel_2 = Panel(surface_curvature.Mean)
panel_3 = Panel(principal_curvature.Min)
panel_4 = Panel(principal_curvature.Max)
vector_display = VectorDisplay(Anchor=principal_curvature.Frame, Vector=amplitude)
