# Grasshopper definition 3.8.4DevelopableTest.gh (Grasshopper 0.9.80)
# plug-ins: Bifocals

md_slider = MDSlider(
    slider_value=Point(0.4512195122, 0.5670731707, 0.5),
    SliderMode=0,
    x_domain=Domain(0, 1),
    y_domain=Domain(0, 1),
    z_domain=Domain(0, 1))
surface = Surface(reparameterize(<surface referenced from the Rhino model>))
osculating_circles = OsculatingCircles(Surface=surface, Point=md_slider)  # -> Point, FirstCircle, SecondCircle
osculating_circles_2 = OsculatingCircles(Surface=surface, Point=md_slider)  # -> Point, FirstCircle, SecondCircle
line = Line(osculating_circles.FirstCircle)
line_2 = Line(osculating_circles.SecondCircle)
line_3 = Line(osculating_circles_2.FirstCircle)
line_4 = Line(osculating_circles_2.SecondCircle)
panel = Panel(osculating_circles.FirstCircle)
panel_2 = Panel(osculating_circles.SecondCircle)
panel_3 = Panel(osculating_circles_2.FirstCircle)
panel_4 = Panel(osculating_circles_2.SecondCircle)
