# Grasshopper definition 3.8.5CurvaturePattern.gh (Grasshopper 0.9.80)
# plug-ins: Bifocals

number_slider = Slider(6, range=0..100)
surface = Surface(reparameterize(<surface referenced from the Rhino model>))
divide_domain² = DivideDomain²(Domain=surface, UCount=number_slider, VCount=number_slider)
md_slider = MDSlider(slider_value=Point(0.5, 0.5, 0.5), SliderMode=0, x_domain=Domain(0, 1), y_domain=Domain(0, 1), z_domain=Domain(0, 1))
isotrim = Isotrim(Surface=surface, Domain=divide_domain²)
surface_curvature = SurfaceCurvature(Surface=reparameterize(isotrim), Point=md_slider)  # -> Frame, Gaussian, Mean
evaluate_surface = EvaluateSurface(Surface=reparameterize(isotrim), Point=md_slider)  # -> Point, Normal, Frame
absolute = Absolute(Value=surface_curvature.Mean)
panel = Panel(surface_curvature.Mean)
minimum = Minimum(A=absolute, B=Slider(0.13, range=0..1))
circle_cnr = CircleCNR(Center=evaluate_surface.Point, Normal=evaluate_surface.Normal, Radius=Slider(0.97, range=0..1))
evaluate = Evaluate(Expression="x>.025", x=minimum)
surface_split = SurfaceSplit(Surface=surface, Curves=circle_cnr)
panel_2 = Panel(circle_cnr)
param_viewer = ParamViewer(circle_cnr)
cull_index = CullIndex(List=surface_split, Indices=Slider(0, range=0..100), Wrap=True)
