# Grasshopper definition 7.1Loops.gh (Grasshopper 0.9.80)
# plug-ins: Bifocals

curve = Curve(<curve referenced from the Rhino model>)

# ----
# Download Hoopsnake from Food4Rhino.com
number_slider = Slider(4, range=0..10)
divide_curve = DivideCurve(Curve=curve, Count=Slider(3, range=0..10), Kinks=False)  # -> Points, Tangents, Parameters
shatter = Shatter(Curve=curve, Parameters=divide_curve.Parameters)
unit_y = UnitY(Factor=number_slider)
list_item = ListItem(List=shatter, Index=Slider(1, range=0..1), Wrap=True)
move = Move(Geometry=list_item, Motion=unit_y)  # -> Geometry, Transform

divide_curve_2 = DivideCurve(Curve=move.Geometry, Count=Slider(3, range=0..10), Kinks=False)  # -> Points, Tangents, Parameters
shatter_2 = Shatter(Curve=move.Geometry, Parameters=divide_curve_2.Parameters)
unit_y_2 = UnitY(Factor=Slider(4, range=0..10))
list_item_2 = ListItem(List=shatter_2, Index=Slider(1, range=0..1), Wrap=True)
move_2 = Move(Geometry=list_item_2, Motion=unit_y_2)  # -> Geometry, Transform
