# Grasshopper definition 8.1 ExtractIsocurves.gh (Grasshopper 0.9.80)
# plug-ins: Bifocals

md_slider = MDSlider(
    slider_value=Point(0.243902439, 0.2926829268, 0.5),
    SliderMode=0,
    x_domain=Domain(0, 1),
    y_domain=Domain(0, 1),
    z_domain=Domain(0, 1))
surface = Surface(reparameterize(<surface referenced from the Rhino model>))
iso_curve = IsoCurve(Surface=surface, UVPoint=md_slider)  # -> UIsocurve, VIsocurve
evaluate_surface = EvaluateSurface(Surface=surface, Point=md_slider)  # -> Point, Normal, Frame
multiplication = Multiplication(A=evaluate_surface.Normal, B=Slider(12, range=0..100))
point = Point(evaluate_surface.Point)
vector_display = VectorDisplay(Anchor=point, Vector=multiplication)
